vi "Function.gvi"   [LabVIEW NXG]
panel indicators:
  "FFT(modulant)": cluster{"f0": f64, "df": f64, "y": f64[]}
  "Modulant": waveform<f64>
  "modulé": waveform<f64>
  "démodulé": waveform<f64>
  "démodulé (downcovert)": cluster{"t0": f64, "dt": f64, "Y": c128[]}
  "abs": waveform<f64>
  "Filtered": waveform<f64>
  "XY(modulant,démodulé)": cluster{"Element 1": f64[], "Element 2": f64[]}
  "cohérent(fft)": cluster{"f0": f64, "df": f64, "y": f64[]}
  "Crète(fft)": cluster{"f0": f64, "df": f64, "y": f64[]}
  "XY(modulant,crète)": cluster{"Element 1": f64[], "Element 2": f64[]}
  "FFT(modulé)": cluster{"f0": f64, "df": f64, "y": f64[]}
  "XY(modulant,modulé)": cluster{"Element 1": f64[], "Element 2": f64[]}
diagram:
  w1 = 20000000  # Fc
  w2 = 200000000  # fs
  # fs
  Reciprocal(x=w2) -> w3
  w4 = 2e-05  # T
  Multiply(w4, w2) -> w5
  Round To Nearest(number=w5) -> w6
  To Long Integer(number=w6) -> w7
  for (N = w7) (iteration -> i1) {
    Reciprocal(x=w2) -> w9
    To Double Precision Float(number=i1) -> w10
    Multiply(w9, w10) -> w11
    append w11 to w8
  }
  w12 = 400000  # fm
  # tn
  Multiply(w8, PiTimes2, w12) -> w13
  Cosine(x=w13) -> w14
  w15 = 1  # Am
  Multiply(w15, w14) -> w16
  Build Waveform Node(Y=w16, dt=w3) -> (output waveform=w17)
  w18 = 1  # Ac
  w19 = 0.7  # ka
  w20 = FALSE  # suppress carrier?
  call "MT Modulate AM (DSB).gvi"(message signal=w17, modulation index=w19, peak message amplitude=w18, suppress carrier?=w20) -> (am modulated waveform=w21)
  call "MT Upconvert Baseband (Real).gvi"(baseband waveform=w21, carrier frequency=w1) -> (passband waveform=w22)
  # Y
  Property Node(instance in=w22) -> ("Y"=w23)
  # X
  Property Node(instance in=w17) -> ("Y"=w24)
  # X
  Build Cluster(w24, w23) -> w25
  $"XY(modulant,modulé)" <- w25
  # Fc
  # ka
  call "MT Downconvert Passband (Real).gvi"(waveform=w22, carrier frequency=w1, passband bandwidth=1000000) -> (downconverted waveform=w26)
  # suppress carrier ?
  call "MT Demodulate AM (DSB).gvi"(am modulated waveform=w26, modulation index=w19, suppressed carrier?=w20) -> (am demodulated waveform=w27)
  # Y
  Property Node(instance in=w27) -> ("Y"=w28)
  Property Node(instance in=w17) -> ("Y"=w29)
  Build Cluster(w29, w28) -> w30
  $"XY(modulant,démodulé)" <- w30
  $Modulant <- w17
  call "FFT.gvi"(y=w22, T=w4) -> (FFT=w31)
  $"FFT(modulé)" <- w31
  Property Node(instance in=w17) -> ("Y"=w32)
  Property Node(instance in=w22) -> ("Y"=w33, "dt"=w34)
  Absolute Value(x=w33) -> w35
  # Fs
  call "FIR Windowed Coefficients.gvi"(filter type="Lowpass", sampling frequency=w2, low cutoff frequency=20000000) -> (FIR windowed coefficients=w36)
  call "FIR Filter (DBL).gvi"(x=w35, FIR coefficients=w36) -> (filtered x=w37)  # FIR Filter.gvi
  Build Waveform Node(Y=w37, dt=w34) -> (output waveform=w38)
  Property Node(instance in=w38) -> ("Y"=w39)
  Build Cluster(w32, w39) -> w40
  $"XY(modulant,crète)" <- w40
  # T
  call "FFT.gvi"(y=w17, T=w4) -> (FFT=w41)
  $"FFT(modulant)" <- w41
  $modulé <- w22
  $"démodulé (downcovert)" <- w26
  call "FFT.gvi"(y=w27, T=w4) -> (FFT=w42)
  $"cohérent(fft)" <- w42
  $démodulé <- w27
  Build Waveform Node(Y=w35, dt=w34) -> (output waveform=w43)
  $abs <- w43
  # démodulé crète ?
  call "FFT.gvi"(y=w38, T=w4) -> (FFT=w44)
  $"Crète(fft)" <- w44
  $Filtered <- w38
