vi "FFT.gvi"   [LabVIEW NXG]
inputs:
  "y": waveform<f64> = {dt=1, Y=[]}
  "T": f64
outputs:
  "FFT": cluster{"f0": f64, "df": f64, "y": f64[]}
diagram:
  Reciprocal(x=$T) -> w1
  w2 = cluster{"f0": f64, "df": f64, "y": f64[]} {all zero or empty}
  Property Node(instance in=$y) -> ("Y"=w3, "dt"=w4)  # Waveform Properties
  Reciprocal(x=w4) -> w5
  Divide(x=w5, y=-2) -> w6
  call "Real FFT.gvi"(x=w3, shift?=TRUE) -> (FFT {x}=w7)
  Absolute Value(x=w7) -> w8
  Logarithm Base 10(x=w8) -> w9
  Multiply(w9, 20) -> w10
  Property Node(instance in=w2, "y"=w10, "f0"=w6, "df"=w1) -> (instance out=w11)
  $FFT <- w11
