vi "Function.gvi"   [LabVIEW NXG]
panel indicators:
  "FFT(modulant)": cluster{"f0": f64, "df": f64, "y": f64[]}
  "Modulant": waveform<f64>
  "modulé": waveform<f64>
  "démodulé": waveform<f64>
  "démodulé (downcovert)": cluster{"t0": f64, "dt": f64, "Y": c128[]}
  "XY(modulant,démodulé)": cluster{"Element 1": f64[], "Element 2": f64[]}
  "cohérent(fft)": cluster{"f0": f64, "df": f64, "y": f64[]}
  "FFT(modulé)": cluster{"f0": f64, "df": f64, "y": f64[]}
  "XY(modulant,modulé)": cluster{"Element 1": f64[], "Element 2": f64[]}
diagram:
  w1 = 2000000  # Fc
  w2 = 200000000  # fs
  # fs
  Reciprocal(x=w2) -> w3
  w4 = 0.002  # T
  Multiply(w4, w2) -> w5
  Round To Nearest(number=w5) -> w6
  To Long Integer(number=w6) -> w7
  for (N = w7) (iteration -> i1) {
    Reciprocal(x=w2) -> w9
    To Double Precision Float(number=i1) -> w10
    Multiply(w9, w10) -> w11
    append w11 to w8
  }
  w12 = 5000  # fm
  # tn
  Multiply(w8, PiTimes2, w12) -> w13
  Cosine(x=w13) -> w14
  w15 = 4  # Am
  Multiply(w15, w14) -> w16
  w17 = 0  # Offset
  Add(w16, w17) -> w18
  Build Waveform Node(Y=w18, dt=w3) -> (output waveform=w19)
  w20 = 25000  # fm deviation(kf)
  call "MT Modulate FM.gvi"(message signal=w19, fm deviation=w20) -> (fm modulated waveform=w21)
  call "MT Upconvert Baseband (Real).gvi"(baseband waveform=w21, carrier frequency=w1) -> (passband waveform=w22)
  # Y
  Property Node(instance in=w22) -> ("Y"=w23)
  # X
  Property Node(instance in=w19) -> ("Y"=w24)
  # X
  Build Cluster(w24, w23) -> w25
  $"XY(modulant,modulé)" <- w25
  call "MT Downconvert Passband (Real).gvi"(waveform=w22, carrier frequency=w1, passband bandwidth=5000) -> (downconverted waveform=w26)
  w27 = FALSE  # suppress carrier?
  call "MT Demodulate FM.gvi"(fm modulated waveform=w26, fm deviation=25000, remove transient when reset?=w27) -> (fm demodulated waveform=w28)
  # Y
  Property Node(instance in=w28) -> ("Y"=w29)
  Property Node(instance in=w19) -> ("Y"=w30)
  Build Cluster(w30, w29) -> w31
  $"XY(modulant,démodulé)" <- w31
  $Modulant <- w19
  call "FFT.gvi"(y=w22, T=w4) -> (FFT=w32)
  $"FFT(modulé)" <- w32
  # T
  call "FFT.gvi"(y=w19, T=w4) -> (FFT=w33)
  $"FFT(modulant)" <- w33
  $modulé <- w22
  $"démodulé (downcovert)" <- w26
  # T
  call "FFT.gvi"(y=w28, T=w4) -> (FFT=w34)
  $"cohérent(fft)" <- w34
  $démodulé <- w28
