vi "Main Demodulate.gvi"   [LabVIEW NXG]
panel controls:
  "Stop": bool
  "device name": string = "192.168.10.2"
  "active antenna": string = "RX1"
  "IQ rate": f64 = 200000
  "carrier frequency": f64 = 95700000
  "gain": f64
  "number of samples": i64 = 10000
  "averaging mode": T2 = "No averaging"
panel indicators:
  "coerced gain": f64
  "coerced frequency": f64
  "coerced IQ rate": f64
  "IQ Plot": f64[][]
  "Frequency Plot": T1
  "Error Out": error
types:
  T1 = cluster{"f0": f64, "df": f64, "magnitude": f64[]}
  T2 = enum{"No averaging", "Vector averaging", "RMS averaging", "Peak hold"}
  T3 = cluster{"averaging mode": T2, "weighting mode": enum{"Linear", "Exponential"}, "number of averages": u32}
diagram:
  call "niUSRP Open Rx Session.gvi"(Device names=$"device name") -> (Error Out=w1, Session handle=w2)
  call "niUSRP Configure Signal.gvi"(session handle=w2, IQ rate=$"IQ rate", carrier frequency=$"carrier frequency", gain=$gain, error in (no error)=w1, active antenna=$"active antenna") -> (session handle out=w3, coerced IQ rate=w4, coerced carrier frequency=w5, coerced gain=w6, Error Out=w7)
  call "niUSRP Initiate.gvi"(session handle=w3, error in (no error)=w7) -> (session handle out=w8, Error Out=w9)
  call "Simple Sound.gvi"(Action="Open") -> (sample rate (S/s)=w10, Error=w11, task ID=w12)
  Reciprocal(x=w4) -> w13
  while {
    call "niUSRP Fetch Rx Data (CDB Cluster).gvi"(session handle=w8, number of samples=$"number of samples", error in (no error)=w9) -> (session handle out=w14, data=w15, Error Out=w16)
    # COMPLETE HERE
    call "MT Demodulate FM.gvi"(fm modulated waveform=w15) -> (fm demodulated waveform=w17)
    Property Node(instance in=w17) -> ("Y"=w18)
    Complex To Real Imaginary(x + iy=w18) -> (x=w19, y=w20)  # Complex to Real and Imaginary
    Build Array(w19, w20) -> w21
    $"IQ Plot" <- w21
    w22 = cluster{"t0": timestamp, "dt": f64, "Y": c128[]} {all zero or empty}
    Property Node(instance in=w22, "Y"=w18, "dt"=w13) -> (instance out=w23)  # Cluster Properties
    w24 = T3 {"averaging mode"="No averaging", "weighting mode"="Exponential", "number of averages"=10}
    Property Node(instance in=w24, "averaging mode"=$"averaging mode") -> (instance out=w25)
    call "FFT Power Spectrum for 1 Chan (CDB).gvi"(time signal=w23, dB On (F)=TRUE, averaging parameters=w25) -> (power spectrum=w26)
    $"Frequency Plot" <- w26
    call "Simple Resample.gvi"(input=w18, coerced IQ rate=w4, sample rate (S/s)=w10) -> (output=w27)
    Build Waveform Node(Y=w27, dt=w13) -> (output waveform=w28)
    call "Simple Sound.gvi"(device ID=w12, error in (no error)=w11, Action="Write", data=w28) -> (Error=w29, task ID=w30)
    Logical Or(w16, w29, $Stop) -> w31
    stop if w31
  }
  call "Simple Sound.gvi"(device ID=w30, error in (no error)=w29, Action="Close") -> (Error=w32)
  Merge Errors(w16, w32) -> (error out=w33)
  call "niUSRP Abort.gvi"(Handle in=w14, error in (no error)=w33) -> (Handle out=w34, Error Out=w35)
  call "niUSRP Close Session.gvi"(Handle in=w34, error in (no error)=w35) -> (Error Out=w36)
  $"Error Out" <- w36
  $"coerced IQ rate" <- w4
  $"coerced frequency" <- w5
  $"coerced gain" <- w6
