vi "student_matched_filtering.gvi"   [LabVIEW NXG]
panel controls:
  "error in (no error)": error
  "Input Complex Waveform": cluster{"t0": f64, "dt": f64, "Y": c128[]}
  "Modulation Parameters In": T6 = {"Modulation Type"="QPSK", "Control Information\nfor Packet Header/Tail"={"Training Sequence (derived)"=[], "Zero Pad Length"=0}, "RX Oversample Factor"=20, "Synchronization Options"={"Synchronization Method"="Timing Estimation", "Fixed Offset"=0, "Symbol Timing Recovery Method"="Max Energy", "Frame Detection Method"="Sliding Correlator", "Correct Frequency Offset"=FALSE}, "Number of Data Symbols (Derived)"=100, "RX Sample Rate"=4000000, "Pulse Shaping Parameters"={"Modulation Type"="PSK", "Pulse Shaping Filter"="Root Raised Cos", "Filter Parameter"=0.5, "Filter Length (Symbols)"=8}, "Channel Estimation/Equalization Parameters"={"Equalization Method"="Direct", "Channel Estimate Length"=1, "Equalizer Length"=1, "Equalizer Delay"=-1}}
panel indicators:
  "error out": error
  "Output Complex Waveform": cluster{"t0": f64, "dt": f64, "Y": c128[]}
  "Modulation Parameters Out": T6
types:
  T1 = cluster{"Training Sequence (derived)": c128[], "Zero Pad Length": i32}
  T2 = cluster{"Synchronization Method": string, "Fixed Offset": i32, "Symbol Timing Recovery Method": string, "Frame Detection Method": string, "Correct Frequency Offset": bool}
  T3 = enum{"none", "Raised Cosine", "Root Raised Cos", "Gaussian"}
  T4 = cluster{"Modulation Type": enum{"FSK", "PSK", "QAM", "MSK", "PAM", "ASK"}, "Pulse Shaping Filter": T3, "Filter Parameter": f64, "Filter Length (Symbols)": i32}
  T5 = cluster{"Equalization Method": string, "Channel Estimate Length": i32, "Equalizer Length": i32, "Equalizer Delay": i32}
  T6 = cluster{"Modulation Type": string, "Control Information\nfor Packet Header/Tail": T1, "RX Oversample Factor": i32, "Synchronization Options": T2, "Number of Data Symbols (Derived)": i32, "RX Sample Rate": f64, "Pulse Shaping Parameters": T4, "Channel Estimation/Equalization Parameters": T5}
diagram:
  case ($"error in (no error)") {
    frame No Error {
      # Apply matched filter
      Property Node(instance in=$"Input Complex Waveform") -> (instance out=w3, "Y"=w4)
      # Generate pulse shaping filter using MT Generate Filter Coefficients.vi
      Property Node(instance in=$"Modulation Parameters In") -> ("Pulse Shaping Parameters:Modulation Type"=w5, "RX Oversample Factor"=w6, "Pulse Shaping Parameters:Pulse Shaping Filter"=w7, "Pulse Shaping Parameters:Filter Parameter"=w8, "Pulse Shaping Parameters:Filter Length (Symbols)"=w9)
      call "MT Generate Filter Coefficients.gvi"(pulse shaping filter=w7, matched samples per symbol=w6, filter parameter=w8, error in=$"error in (no error)", modulation type=w5, filter length=w9) -> (matched filter coefficients=w10, error out=w1)
      To Double Precision Complex(number=w10) -> w11
      call "1D Convolution (CDB).gvi"(x=w11, y=w4) -> (x * y=w12)
      Property Node(instance in=w3, "Y"=w12) -> (instance out=w2)
    }
    frame Error {
      w1 = $"error in (no error)"
      w2 = default
    }
  }
  $"Output Complex Waveform" <- w2
  $"Modulation Parameters Out" <- $"Modulation Parameters In"
  $"error out" <- w1
