vi "student_modulate.gvi"   [LabVIEW NXG]
inputs:
  "Modulation Parameters In": T4 = {"Modulation Type"="QPSK", "Pulse Shaping Parameters"={"Modulation Type"="PSK", "Pulse Shaping Filter"="Root Raised Cos", "Filter Parameter"=0.5, "Filter Length (Symbols)"=8}, "TX Oversample Factor"=20, "Packet Length (Bits)"=500, "TX Sample Rate"=100, "Control Information For Packet Header/Tail"={"Training Sequence "="Length 11 Barker Sequence", "Zero Pad Length"=8}}
  "Input Bit Stream": i8[]
  "Error In": error
outputs:
  "Modulation Parameters Out": T4
  "Output Symbols": c128[]
  "Error Out": error
panel controls:
  "Symbol Energy (1)": f64 = 1
types:
  T1 = enum{"none", "Raised Cosine", "Root Raised Cos", "Gaussian"}
  T2 = cluster{"Modulation Type": enum{"FSK", "PSK", "QAM", "MSK", "PAM", "ASK"}, "Pulse Shaping Filter": T1, "Filter Parameter": f64, "Filter Length (Symbols)": i32}
  T3 = cluster{"Training Sequence ": string, "Zero Pad Length": i32}
  T4 = cluster{"Modulation Type": string, "Pulse Shaping Parameters": T2, "TX Oversample Factor": i32, "Packet Length (Bits)": i32, "TX Sample Rate": f64, "Control Information For Packet Header/Tail": T3}
diagram:
  $"Modulation Parameters Out" <- $"Modulation Parameters In"
  case ($"Error In") {
    frame No Error, Default {
      # Error check bit stream and translate bit stream into bit words
      Property Node(instance in=$"Modulation Parameters In") -> ("Modulation Type"=w3)
      case (w3) {
        frame "QPSK" {
          Decimate Array(array=$"Input Bit Stream") -> (out0=w5, out1=w6)
          Multiply(2, w5) -> w7
          Add(w7, w6) -> w8
          Quotient And Remainder(x=w8, y=4) -> (x-y*floor(x/y)=w4)
        }
        frame "BPSK", Default {
          Quotient And Remainder(x=$"Input Bit Stream", y=2) -> (x-y*floor(x/y)=w4)
        }
      }
      # Modulate input bit stream with appropriate constellation map
      for {
        w9 = each element of w4
        case (w3) {
          frame "QPSK" {
            # QPSK Constellation Map
            w11 = [1+1i, 1-1i, -1+1i, -1-1i]
          }
          frame "BPSK", Default {
            # BPSK Constellation Map
            w11 = [1, -1]
          }
        }
        Array Index(array=w11) -> (out0[w9]=w12)
        append w12 to w10
      }
      call "symbol_energy.gvi"(input symbols=w10, Symbol Energy (1)=$"Symbol Energy (1)") -> (output symbols=w2)
      w1 = $"Error In"
    }
    frame Error {
      w1 = $"Error In"
      w2 = c128[] []
    }
  }
  $"Output Symbols" <- w2
  $"Error Out" <- w1
