vi "student_pulse_shaping.gvi"   [LabVIEW NXG]
panel controls:
  "error in (no error)": error
  "input_2": c128[]
  "Modulation Parameters In": T4 = {"Modulation Type"="QPSK", "Pulse Shaping Parameters"={"Modulation Type"="PSK", "Pulse Shaping Filter"="Raised Cosine", "Filter Parameter"=0.5, "Filter Length (Symbols)"=8}, "TX Oversample Factor"=20, "Packet Length (Bits)"=500, "TX Sample Rate"=100, "Control Information For Packet Header/Tail"={"Training Sequence "="Length 11 Barker Sequence", "Zero Pad Length"=8}}
panel indicators:
  "error out": error
  "output": c128[]
  "filter coefficients": f64[]
  "samples/symbol": i32
  "Modulation Parameters Out": T4
types:
  T1 = enum{"none", "Raised Cosine", "Root Raised Cos", "Gaussian"}
  T2 = cluster{"Modulation Type": enum{"FSK", "PSK", "QAM", "MSK", "PAM", "ASK"}, "Pulse Shaping Filter": T1, "Filter Parameter": f64, "Filter Length (Symbols)": i32}
  T3 = cluster{"Training Sequence ": string, "Zero Pad Length": i32}
  T4 = cluster{"Modulation Type": string, "Pulse Shaping Parameters": T2, "TX Oversample Factor": i32, "Packet Length (Bits)": i32, "TX Sample Rate": f64, "Control Information For Packet Header/Tail": T3}
diagram:
  $"Modulation Parameters Out" <- $"Modulation Parameters In"
  case ($"error in (no error)") {
    frame No Error {
      Property Node(instance in=$"Modulation Parameters In") -> ("TX Oversample Factor"=w4, "Pulse Shaping Parameters:Modulation Type"=w5, "Pulse Shaping Parameters:Pulse Shaping Filter"=w6, "Pulse Shaping Parameters:Filter Parameter"=w7, "Pulse Shaping Parameters:Filter Length (Symbols)"=w8)
      # Generate pulse shaping filter using MT Generate Filter Coefficients.vi
      $"samples/symbol" <- w4
      # TX oversample factor
      # Upsample input and apply pulse shaping filter
      call "Upsample (CDB).gvi"(x=$input_2, upsampling factor=w4) -> (upsampled array=w9)
      call "MT Generate Filter Coefficients.gvi"(pulse shaping filter=w6, pulse shaping samples per symbol=w4, filter parameter=w7, error in=$"error in (no error)", modulation type=w5, filter length=w8) -> (pulse shaping filter coefficients=w2, error out=w1)
      To Double Precision Complex(number=w2) -> w10
      call "1D Convolution (CDB).gvi"(x=w10, y=w9) -> (x * y=w3)
    }
    frame Error {
      w1 = $"error in (no error)"
      w2 = default
      w3 = default
    }
  }
  $"filter coefficients" <- w2
  $"error out" <- w1
  $output <- w3
